# Requirement set shortest_path_func_reqs (R2022b)

## 1 [#1] Overview (Informational)
We need a function to compute the shortest path through a graph from a start node index to an end node index. The graph is specified by an adjacency matrix and nodes are identified by their index in that graph:
pathLength = shortest_path(adjMatrix, startIdx, endIdx)
The interface should be as follows:
| Input Argument | Type | Dimension |
| adjMatrix | double | 1x1 scalar |
| startIdx | double | 1x1 scalar |
| endIdx | double | NxN matrix |
| Output | Type | Dimension |
| pathLength | double | 1x1 scalar |

## 2 [#2] Functional behavior (Container)

### 2.1 [#12] Nominal behavior (Container)
Priority: High

#### 2.1.1 [#3] Returns the number of edges in shortest path from startIdx to endIdx
Priority: High

### 2.2 [#8] Exceptional conditions (Container)
The following exceptional cases should be processed in the order specified where negative value error codes are returned.
The function should be designed so that it never throws an error and always returns a non-negative number to indicate a path or a negative number to indicate some abnormal condition.
Priority: High

#### 2.2.1 [#9] Returns -9 for invalid adjacency matrices
Valid adjacency matrices should be:
1. Square matrices
2. All entries are either 0 or 1
Priority: Low

#### 2.2.2 [#10] Returns -19 if the start node is encoded incorrectly
Encoding for a node must be finite and represent an integer.
Priority: Low

#### 2.2.3 [#11] Returns -29 if end node is encoded incorrectly
Encoding for a node must be finite and represent an integer.
Priority: Low

#### 2.2.4 [#6] Returns -99 if startIdx or endIdx > number of rows of Adj
Priority: Medium

#### 2.2.5 [#7] Returns -199 if startIdx or endIdx are < 1
Priority: Medium

#### 2.2.6 [#5] Returns 0 if startIdx == endIdx
Every node is implitly assumed to be directed to itself with a path of length 0. Even if that node has no edges.
Priority: High

#### 2.2.7 [#4] Returns -1 if no path from startIdx to endIdx exists
Priority: High