# Requirement set shortest_path_tests_reqs (R2022a)

## 1 [#1] Overview (Informational)
This is the test requirements derived from the functional requirements

## 2 [#2] Test Cases (Container)

### 2.1 [#22] Nominal Mode Tests (Container)

#### 2.1.1 [#8] Test for path length 1

#### 2.1.2 [#6] Test for a simple graph with no cycles

#### 2.1.3 [#7] Test for a graph that is a tree

#### 2.1.4 [#5] Test for a graph that contains cycles

#### 2.1.5 [#3] Test when shortest path is not unique

#### 2.1.6 [#4] Test for path length N where N is number of nodes (largest possible path)

#### 2.1.7 [#10] Test a graph which has no edges
In this situation the return value should be -1 whenever startIdx is not equal to endIdx.

#### 2.1.8 [#12] Test a graph starting from a node with no edges
the return value should be -1.

#### 2.1.9 [#13] Test a graph ending on a node with no edges
Returns -99

### 2.2 [#15] Tests for invalid conditions (Container)

#### 2.2.1 [#18] Test with invalid startIdx > N

#### 2.2.2 [#14] Test with invalid startIdx <1
Returns -199

#### 2.2.3 [#20] Test with invalid endIdx > N

#### 2.2.4 [#21] Test with invalid endIdx < 1

#### 2.2.5 [#11] Test a degenerate graph without nodes
Any possible value of startIdx and endIdx will be invalid.