% Requirement links of shortest_path.m (R2023a)

% line 22 implements shortest_path_func_reqs.slreqx#9
        ErrorCode = -9

% line 27 implements shortest_path_func_reqs.slreqx#10
        ErrorCode = -19;

% line 32 implements shortest_path_func_reqs.slreqx#11
        ErrorCode = -29;

% lines 35-38 implements shortest_path_func_reqs.slreqx#6
    [nodeCnt, n] = size(adjMatrix);

    % Start or end node is too large
    if startIdx > nodeCnt || endIdx > nodeCnt

% lines 39-44 implements shortest_path_func_reqs.slreqx#7
        ErrorCode = -99;
    end

    % Start or end node is too small
    if startIdx < 1 || endIdx < 1
        ErrorCode = -199;

% lines 49-55 implements shortest_path_func_reqs.slreqx#5
        return;
    end

    %% Self-loop path is always 0
    if startIdx  == endIdx
        pathLength = 0;
        return;

% line 93 implements shortest_path_func_reqs.slreqx#4
        visited(nodeIdx) = true;

% lines 94-101 implements shortest_path_func_reqs.slreqx#3
        if nodeIdx == endIdx
            pathLength = distance(nodeIdx);

            if (pathLength==realmax)
                % No path exists so set distance to -1;
                pathLength = -1;
            end
            return;

% lines 112-121 implements shortest_path_func_reqs.slreqx#10
% lines 112-121 implements shortest_path_func_reqs.slreqx#11
        end
    end
end

function out = isNodeValid(node)
    % For full coverage we need to create negative tests that make each
    % successively make each validity condition false
    if(isscalar(node) && isnumeric(node) && ~isinf(node) && floor(node) == node)
        out = true;
    else

% lines 122-135 implements shortest_path_func_reqs.slreqx#9
        out = false;
    end
end

function out = isAdjMatrixValid(adjMatrix)
    % need to be a square matrix with only 0, 1, or realmax entries. 
    [m, n] = size(adjMatrix);

    % For full coverage we need to create negative tests that make each
    % successively make each validity condition false
    if (m==n) && isempty(find((adjMatrix ~= 0) & (adjMatrix ~= 1), 1))
        out = true;
    else
        out = false;