% Requirement links of graph_unit_tests.m (R2023a)

% line 1 verifies shortest_path_tests_reqs.slreqx#1
classdef graph_unit_tests < matlab.unittest.TestCase

% line 7 verifies shortest_path_tests_reqs.slreqx#14
% line 7 verifies shortest_path_tests_reqs.slreqx#14
% line 7 verifies shortest_path_func_reqs.slreqx#7
        function check_invalid_start_1(testCase)

% line 15 verifies shortest_path_tests_reqs.slreqx#18
% line 15 verifies shortest_path_tests_reqs.slreqx#18
% line 15 verifies shortest_path_func_reqs.slreqx#6
        function check_invalid_start_2(testCase)

% line 23 verifies shortest_path_tests_reqs.slreqx#21
% line 23 verifies shortest_path_tests_reqs.slreqx#21
% line 23 verifies shortest_path_func_reqs.slreqx#7
        function check_invalid_end_1(testCase)

% line 31 verifies shortest_path_tests_reqs.slreqx#20
% line 31 verifies shortest_path_tests_reqs.slreqx#20
% line 31 verifies shortest_path_func_reqs.slreqx#6
        function check_invalid_end_2(testCase)

% line 41 verifies shortest_path_tests_reqs.slreqx#10
% line 41 verifies shortest_path_func_reqs.slreqx#4
    function check_edgeless_graph(testCase)

% line 49 verifies shortest_path_tests_reqs.slreqx#12
% line 49 verifies shortest_path_func_reqs.slreqx#4
        function check_edgeless_start(testCase)

% line 57 verifies shortest_path_tests_reqs.slreqx#13
% line 57 verifies shortest_path_func_reqs.slreqx#4
        function check_edgeless_end(testCase)

% line 64 verifies shortest_path_func_reqs.slreqx#5
        function check_edgeless_graph_self_loop(testCase)

% line 76 verifies shortest_path_tests_reqs.slreqx#4
% line 76 verifies shortest_path_tests_reqs.slreqx#6
% line 76 verifies shortest_path_func_reqs.slreqx#3
        function check_longest_path(testCase)

% line 84 verifies shortest_path_tests_reqs.slreqx#8
% line 84 verifies shortest_path_func_reqs.slreqx#3
        function check_unity_path(testCase)

% line 92 verifies shortest_path_tests_reqs.slreqx#3
% line 92 verifies shortest_path_tests_reqs.slreqx#5
        function check_non_unique(testCase)

% line 100 verifies shortest_path_func_reqs.slreqx#4
        function check_no_path(testCase)

% line 108 verifies shortest_path_func_reqs.slreqx#5
        function check_start_end_same(testCase)

% line 116 verifies shortest_path_tests_reqs.slreqx#11
        function check_invalid_idx_empty_adj(testCase)